# Grasshopper definition module B_showcase.ghx (Grasshopper 1.0.7)

sample_parcels = GhPythonScript()  # -> out, sampleString
# ---------- sample_parcels: Python ----------
__author__ = "Admin"
__version__ = "2022.07.18"

import rhinoscriptsyntax as rs
import json


sampleJSON = {"id": "13", "type": "Feature", "properties": {"Name": "kml_15309", "tessellate": -1, "extrude": 0, "visibility": -1, "LU_DESC": "RESIDENTIAL", "LU_TEXT": "", "GPR": "2.8", "INC_CRC": "87C6535070575AB1", "FMEL_UPD_D": "20191209171711", "snippet": "", "UD_ID": "LU_13",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


sampleString = json.dumps(sampleJSON)
print(sampleJSON['properties'].keys())
# ---------- end sample_parcels ----------
bkeyxscale = Slider(0.6, range=0..1)
parcelstoreyscale = Slider(1, range=0..1)
bkeyyscale = Slider(0.9, range=0..1)

# ---- group: RH_IN:BKeyXScale
num = Number(bkeyxscale)

# ---- group: RH_IN:BKeyYScale
num_2 = Number(bkeyyscale)

# ---- group: RH_IN:GridAngle
num_3 = Number(Slider(50, range=0..180))

# ---- group: RH_IN:GridSpacing
num_4 = Number(Slider(10, range=0..100))

# ---- group: RH_IN:ParcelStoreyScale
num_5 = Number(parcelstoreyscale)

# ---- group: RH_IN:ParcelJSON
txt = Text(sample_parcels.sampleString)

# ---- group: Deconstruct JSON
sample_parcels_2 = GhPythonScript(jsonString=txt)  # -> out, ParcelID, ParcelBoundary, ParcelEdgeCategory, ParcelGPR, ParcelBKeyIndex
# ---------- sample_parcels_2: Python ----------
__author__ = "Admin"
__version__ = "2022.07.18"

import rhinoscriptsyntax as rs
import ghpythonlib.components as gh
import json

feature = json.loads(jsonString)

ParcelID = feature['properties']['UD_ID']
coordinates = feature['geometry']['coordinates']

ParcelEdgeCategory = feature['properties']['UD_EdgeCategory']
ParcelBoundary = gh.PolyLine([gh.ConstructPoint(c[0],c[1],0)for c in coordinates[0]], True)

if isinstance(feature['properties']['GPR'], float) != True:
    ParcelGPR=3.0
else:
    ParcelGPR = feature['properties']['GPR']

ParcelBKeyIndex = feature['properties']['BKeySelection']
# ---------- end sample_parcels_2 ----------

# ---- group: Select correct BKey
blockkey_collection = Curve([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])
cluster = Cluster(relay=blockkey_collection, relay_2=sample_parcels_2.ParcelBKeyIndex, X=num, Y=num_2)

# ----
parcelboundary = Curve(sample_parcels_2.ParcelBoundary)
python = GhPythonScript(
    ParcelBoundary=graft(parcelboundary),
    SelectedBKey=cluster,
    ParcelStoreyScale=graft(num_5),
    minStoreyConstraint="8",
    ParcelGPR=sample_parcels_2.ParcelGPR)  # -> out, simplify(BlockHeights); inputs ParcelBoundary: tree of Curve, SelectedBKey: tree of Curve, ParcelStoreyScale: tree, minStoreyConstraint: Int32
# ---------- python: Python ----------
import rhinoscriptsyntax as rs
import ghpythonlib.treehelpers as th
import ghpythonlib.components as gh
import Rhino
import json
import math

def Remap(value,low1,high1,low2,high2):
    return low2 + (value - low1) * (high2 - low2) / (high1 - low1)

def ProcessFootPrint(object):
    box = gh.BoundingBox(object,gh.XYPlane(gh.ConstructPoint(0,0,0)))
    xdom = gh.DeconstructBox(box).x[0]
    ydom = gh.DeconstructBox(box).y[0]
    bBox = gh.PolyLine([gh.ConstructPoint(xdom[0], ydom[0], 0), gh.ConstructPoint(xdom[1], ydom[0], 0), gh.ConstructPoint(xdom[1], ydom[1], 0), gh.ConstructPoint(xdom[0], ydom[1], 0)], True)
    return [max(xdom[1]-xdom[0],ydom[1]-ydom[0]), bBox]

def GetMaxAllowedStoreys(GPR,blockLength):
    if blockLength > 130:
        maxA = 8
    elif blockLength > 90:
        maxA = 12
    elif blockLength > 75:
        maxA = 18
    elif blockLength > 60:
        maxA = 24
    else:
        maxA = 80    
    
    if GPR <= 1.4:
        maxB = 5
    elif GPR <= 1.6:
        maxB = 12
    elif GPR <= 2.1:
        maxB = 24
    elif GPR <= 2.8:
        maxB = 36
    else:
        maxB = 50
    return min(maxA, maxB)

def OffsetCategoryToDistances(edgeCategory,maxStorey):
    ans = []
    
    # SETBACK 1: Setback according to height of blocks (parametric): CommonBoundarySetback
    setbacks = [0,0,3,3.4,3.8,4.7,5.5,6.4,7.2,8,8.7,9,9.2,9.5,9.8,10.1,10.3,10.6,10.8,11.1,11.3,11.6,11.8,12.1,12.4,12.7,12.9,13.2,13.4,13.7,14,14.2,14.5,14.7,15,15.2]
    if maxStorey < 36:
        CommonBoundarySetback = setbacks[maxStorey]
    else:
        CommonBoundarySetback = 15.5
    # SETBACK 2: Setback according to type of roads (static): RoadCategorySetback
    for c in edgeCategory:
        if c == 3:
            RoadCategorySetback = 2 + 10.2 + 3 + 2 + 2.4 + 2.0
        if c == 4:
            RoadCategorySetback = 0.6 + 7 + 1.9 + 2.0 + 2.4
        if c == 5:
            RoadCategorySetback = 5 + 2.5 + 1.8
        if c == None:
            RoadCategorySetback = 0
        
        # USE MORE STRINGENT SETBACK
        if RoadCategorySetback > CommonBoundarySetback:
            ans.append(RoadCategorySetback)
        else:
            ans.append(CommonBoundarySetback)
    return ans

def OffsetPolyManyDistsInwards(polyline,distances):
    if gh.Area(gh.OffsetCurve(polyline,distances[0],None,1))[0] < gh.Area(gh.OffsetCurve(polyline,-distances[0],None,1))[0]:
        polyOffsetRef = gh.OffsetCurve(polyline,10,None,1)
    else:
        polyOffsetRef = gh.OffsetCurve(polyline,-10,None,1)
    segments, vertices = gh.Explode(polyline, True)
    segmentsRef, verticesRef = gh.Explode(polyOffsetRef, True)
    centroid = gh.Area(polyline)[1]
    offsetSegments = []
    finalVertices = []
    for i in range(len(distances)):
        dist = distances[i]
        offsetA = gh.OffsetCurve(segments[i],dist,None,0)
        offsetB = gh.OffsetCurve(segments[i],-dist,None,0)
        if gh.CurveClosestPoint(rs.CurveMidPoint(offsetA),polyOffsetRef)[2] < gh.CurveClosestPoint(rs.CurveMidPoint(offsetB),polyOffsetRef)[2]:
            offsetSegments.append(offsetA)
        else:
            offsetSegments.append(offsetB)
    
    for i in range(len(offsetSegments)):
        currOffset = offsetSegments[i]
        prevOffset = offsetSegments[i-1]
        pta,ptb,dist = gh.CurveProximity(currOffset,prevOffset)
        if dist < 0.5:
            finalVertices.append(pta)
        else:
            finalVertices.append(gh.LineXLine(offsetSegments[i],offsetSegments[i-1])[2])
    return gh.PolyLine(finalVertices, True)

def getPossibleSolutions(bkeyBound, siteBound, GPR, minStoreys):
    solutions = []
    bkeyArea = gh.Area(bkeyBound)[0]
    siteArea = gh.Area(siteBound)[0]
    
    processedFootPrint = ProcessFootPrint(bkeyBound)
    bound = processedFootPrint[1]
    targetTotalStoreys = int(math.floor(GPR * siteArea / bkeyArea))
    maxStoreys = GetMaxAllowedStoreys(GPR,processedFootPrint[0])
    maxBlockCount = int(math.floor(0.5 * siteArea * GPR / bkeyArea))
    
    for i in range(maxBlockCount,0,-1):
        highestDenominator = int(math.ceil((GPR * siteArea) / (bkeyArea * i)))
        blockStoreys = [highestDenominator]*i
        extraStoreys = (highestDenominator * i) - targetTotalStoreys

        for j in range(extraStoreys):
            blockStoreys[-1-j] -= 1
        
        if min(blockStoreys) >= minStoreys and max(blockStoreys) <= maxStoreys:
            if highestDenominator <= maxStoreys:
                solutions.append(json.dumps({'numBlocks': i, 'blockStoreys': blockStoreys}))
    
    #print('max block count: {0}, max storeys: {1}, total storeys required: {2}'.format(maxBlockCount,maxStoreys,targetTotalStoreys))
    return solutions

def GetOrientedBKey(parcelBoundary,parcelObstacle,sortedGridPlanes,selectedBKey, targetCount):
    successfulBKey = []
    successfulOrientation = []
    obstacles = [parcelObstacle]
    for gridPlane in sortedGridPlanes:
        orientedBKey = gh.Orient(selectedBKey,gh.XYPlane(gh.ConstructPoint(0,0,0)),gridPlane)[0]
        
        boxOffset = 10
        orientedBBox = gh.BoundingBox(orientedBKey,gridPlane)[0]
        orientedBBox.X = Rhino.Geometry.Interval(orientedBBox.X[0]-boxOffset,orientedBBox.X[1]+boxOffset)
        orientedBBox.Y = Rhino.Geometry.Interval(orientedBBox.Y[0]-boxOffset,orientedBBox.Y[1]+boxOffset)


        if gh.CollisionOneXMany(orientedBBox,obstacles)['collision'] == False:
            successfulBKey.append(orientedBKey)
            successfulOrientation.append(gridPlane)
            obstacles.append(orientedBKey)
                    
        if len(successfulBKey) == targetCount:
            break
    return successfulBKey,successfulOrientation

def RoundPoint(pt):
    rounded = [float("{:.7f}".format(c)) for c in pt]
    return rounded


def GetParcelJSON(OrientedBKeyFootprint,BlockHeights,OrientPlane,ObstacleCP):
    ans = {}
    for i in range(len(OrientedBKeyFootprint)):
        bldg_id = str(i).rjust(4,"0")
        ans['{0}_Bldg_{1}'.format(ParcelID,bldg_id)] = {'geometry':{},'properties':{}}
        ans['{0}_Bldg_{1}'.format(ParcelID,bldg_id)]['geometry']['type'] = 'Polygon'
        ans['{0}_Bldg_{1}'.format(ParcelID,bldg_id)]['geometry']['coordinates'] = [RoundPoint(pt) for pt in gh.ControlPoints(OrientedBKeyFootprint[i])[0]]
        ans['{0}_Bldg_{1}'.format(ParcelID,bldg_id)]['properties']['storeys'] = BlockHeights[i]
        ans['{0}_Bldg_{1}'.format(ParcelID,bldg_id)]['properties']['orientation'] = {'origin': RoundPoint(OrientPlane[i].Origin),'XAxis':RoundPoint(OrientPlane[i].XAxis),'YAxis':RoundPoint(OrientPlane[i].YAxis)}
        ans['{0}_Bldg_{1}'.format(ParcelID,bldg_id)]['properties']['obstacle'] = [RoundPoint(pt) for pt in ObstacleCP]
    return json.dumps(ans, indent=2)

def GetObstacleCP(curve):
    polyline = gh.CurveToPolyline(curve,0,math.pi/10,None,None)[0]
    return gh.ControlPoints(polyline)[0]

def GetLargerRegionDifference(parcelSetback,siteAccess):
    regions = gh.RegionDifference(parcelSetback,siteAccess)
    try:
        areas = [gh.Area(region)[0] for region in regions]
        return [x for _, x in sorted(zip(areas, regions))][-1]
    except:
        return regions

def OffsetList(lst):
  return lst[1:] + lst[:1]
  
def ClassifyEdgeIndices(crv):
        count=0
        vertices=rs.PolylineVertices(crv)
        vertices.pop()
        edgeindices=[]
        for i in range(len(vertices)):
            if i==0:
                vector1=rs.VectorCreate(vertices[len(vertices)-1],vertices[0])
                vector2=rs.VectorCreate(vertices[1],vertices[0])
                
            elif i==len(vertices)-1:
                vector1=rs.VectorCreate(vertices[i-1],vertices[len(vertices)-1])
                vector2=rs.VectorCreate(vertices[0],vertices[len(vertices)-1])
                
            else: 
        
                vector1=rs.VectorCreate(vertices[i-1],vertices[i])
                vector2=rs.VectorCreate(vertices[i+1],vertices[i])
                
            angle=rs.VectorAngle(vector1,vector2)
            if rs.VectorCrossProduct(vector1,vector2).Z>0:
                angle=360-angle
    
            if angle<135 or angle>225:
                count+=1
    
            edgeindices.append(count)

            
        if edgeindices[0]==1:
            for i in range(len(edgeindices)):
                edgeindices[i]=edgeindices[i]-1
        return edgeindices

def ReorderSegments(segment,category):
    mysegment = segment
    mycategory = category
    while True:
        if mycategory[0] == mycategory[-1]:
            mysegment = OffsetList(mysegment)
            mycategory = OffsetList(mycategory)
        else:
            break
    return mysegment,mycategory

def GroupEdgeIndices(crv):
        count=0
        vertices=rs.PolylineVertices(crv)
        vertices.pop()
        edgeindices=[]
        for i in range(len(vertices)):
            if i==0:
                vector1=rs.VectorCreate(vertices[len(vertices)-1],vertices[0])
                vector2=rs.VectorCreate(vertices[1],vertices[0])
                
            elif i==len(vertices)-1:
                vector1=rs.VectorCreate(vertices[i-1],vertices[len(vertices)-1])
                vector2=rs.VectorCreate(vertices[0],vertices[len(vertices)-1])
                
            else: 
        
                vector1=rs.VectorCreate(vertices[i-1],vertices[i])
                vector2=rs.VectorCreate(vertices[i+1],vertices[i])
                
            angle=rs.VectorAngle(vector1,vector2)
            if rs.VectorCrossProduct(vector1,vector2).Z>0:
                angle=360-angle
    
            if angle<135 or angle>225:
                count+=1
    
            edgeindices.append(count)

            
        if edgeindices[0]==1:
            for i in range(len(edgeindices)):
                edgeindices[i]=edgeindices[i]-1
        return list(edgeindices)

def GetSimplifedSegments(boundary,indicies,category):
    segments = gh.Explode(boundary,True)[0]
    simplifiedSegments = []
    simplifiedCategory = []
    temp = [segments[0]]
    prevIndex = indicies[0]
    for i in range(1,len(indicies)):
        currIndex = indicies[i]
        if prevIndex == currIndex:
            temp.append(segments[i])
        elif prevIndex != currIndex:
            simplifiedSegments.append(gh.JoinCurves(temp,True))
            simplifiedCategory.append(category[i-1])
            temp = [segments[i]]
            prevIndex = currIndex
    simplifiedSegments.append(gh.JoinCurves(temp,True))
    simplifiedCategory.append(category[i-1])
    return simplifiedSegments,simplifiedCategory

def OffsetSimplifiedSegments(simplifiedSegments,offsetDistances):
    
    orginalBoundary = gh.JoinCurves(simplifiedSegments,True)
    offsetSegment = []

    for i in range(len(simplifiedSegments)):
        offsetA = gh.OffsetCurve(simplifiedSegments[i],offsetDistances[i],gh.XYPlane(gh.ConstructPoint(0,0,0)),1)
        offsetB = gh.OffsetCurve(simplifiedSegments[i],-offsetDistances[i],gh.XYPlane(gh.ConstructPoint(0,0,0)),1)
        
        if type(offsetA) is not list:
            offsetA = [offsetA]
        if type(offsetB) is not list:
            offsetB = [offsetB]
        
        if all([gh.PointInCurve(gh.CurveMiddle(offset),orginalBoundary)[0] == 2 for offset in offsetA]):
            offsetSegment += offsetA
        else:
            offsetSegment += offsetB
    return offsetSegment

def RebuildOffsetSegments(simplfiedOffsetSegments):
    
    crvs = simplfiedOffsetSegments
    temp = []
    for i in range(len(crvs)):
        if gh.CurveXCurve(crvs[i],crvs[:i]+crvs[i+1:])[0] != None:
            temp.append(crvs[i])
    simplfiedOffsetSegments = temp
    connectors = [simplfiedOffsetSegments[0]]

    for i in range(1,len(simplfiedOffsetSegments)):
        
        currSeg = simplfiedOffsetSegments[i]
        prevSeg = simplfiedOffsetSegments[i-1]
        intersection, ta, tb = gh.CurveXCurve(currSeg,prevSeg)
        
        if intersection == None:
            pta,ptb,dist = gh.CurveProximity(currSeg,prevSeg)
            if dist < 2:
                connectors.append(gh.Line(pta,ptb))
                connectors.append(currSeg)
            else:
                currExt = gh.ExtendCurve(currSeg,2,dist,dist)
                prevExt = gh.ExtendCurve(prevSeg,2,dist,dist)
                intersection, ta, tb = gh.CurveXCurve(currExt,prevExt)
                connectors.append(gh.Line(pta,intersection))
                connectors.append(gh.Line(ptb,intersection))
                connectors.append(currSeg)
        else:
            connectors.append(currSeg)
    
    connectors = gh.JoinCurves(connectors,False)

    for i in range(len(connectors)):
        pt,ta,tb = gh.CurveXCurve(connectors[i],connectors[i-1])
        sa = gh.Shatter(connectors[i],ta)
        la = [gh.Length(sh) for sh in sa]
        sb = gh.Shatter(connectors[i-1],tb)
        lb = [gh.Length(sh) for sh in sb]
        connectors[i] = [x for _,x in sorted(zip(la,sa))][-1]
        connectors[i-1] = [x for _,x in sorted(zip(lb,sb))][-1]
        
        
    return gh.JoinCurves(connectors,False)
    

BlockHeights = []
ParcelObstacle = []
OrientedBKeyFootprint = []
OrientationPlane = []
a = []

for path in ParcelBoundary.Paths:

    
    try:
        parcelBoundary = ParcelBoundary.Branch(path)[0]
        selectedBKey = SelectedBKey.Branch(path)[0]
        parcelStoreyScale = ParcelStoreyScale.Branch(path)[0]
        
        # Precompute some information
        bkeyArea = gh.Area(selectedBKey)[0]
        siteArea = gh.Area(parcelBoundary)[0]
        processedFootPrint = ProcessFootPrint(selectedBKey)
        targetTotalStoreys = int(math.floor(ParcelGPR * siteArea / bkeyArea))
        maxStoreys = GetMaxAllowedStoreys(ParcelGPR,processedFootPrint[0])
        maxBlockCount = int(math.floor(0.5 * siteArea * ParcelGPR / bkeyArea))
        
        # Precompute all solutions, then select one solution based of storeyScale
        possibleSolutions = getPossibleSolutions(selectedBKey, parcelBoundary, ParcelGPR, minStoreyConstraint)
        selectedSolution = possibleSolutions[int(Remap(parcelStoreyScale,0,1,0,len(possibleSolutions)-1))]
        
        # Generate parametric setback based on edgetype and height
        blockHeights = json.loads(selectedSolution)['blockStoreys']
        
        BlockHeights.append(blockHeights)
    
    except Exception as e: print(e)

BlockHeights = th.list_to_tree(BlockHeights)
# ---------- end python ----------
simplified_segments = GhPythonScript(ParcelCrv=parcelboundary)  # -> out, simplify(ParcelEdgeCategories); inputs ParcelCrv: tree of Curve, RoadNetwork: list of Curve, RoadType: list
# ---------- simplified_segments: Python ----------
__author__ = "Admin"
__version__ = "2022.09.07"

import rhinoscriptsyntax as rs
import Rhino
import ghpythonlib.components as gh
import ghpythonlib.treehelpers as th

ans = []
a = []
for path in ParcelCrv.Paths:
    
    category = []
    
    segments = gh.Explode(ParcelCrv.Branch(path)[0],True)[0]
    offset = gh.OffsetCurve(ParcelCrv.Branch(path)[0],-50,gh.XYPlane(gh.ConstructPoint(0,0,0)),1)
    subsetRN = []
    subsetRT = []
    
    for i,(rn,rt) in enumerate(zip(RoadNetwork,RoadType)):
        try:
            if any([gh.PointInCurve(cp, offset)[0] !=0   for cp in gh.ControlPoints(rn)[0]]):
                subsetRN.append(rn)
                subsetRT.append(rt)
        except:
            pass

    for segment in segments:
        
        midPt = gh.CurveMiddle(segment)
        crossVector = gh.EvaluateCurve(segment,gh.CurveClosestPoint(midPt,segment)[1])[1]
        crossLine = gh.LineSDL(midPt,gh.CrossProduct(gh.UnitZ(1),crossVector,False)[0],25)
        intersectionTest = [gh.CurveXCurve(test,crossLine)[0] != None for test in subsetRN]
        
        if all([t == False for t in intersectionTest]):
            category.append(6)
        
        else:
            index = intersectionTest.index(True)
            category.append(subsetRT[index])

    ans.append(category)

ParcelEdgeCategories = th.list_to_tree(ans)
# ---------- end simplified_segments ----------
python_2 = GhPythonScript(
    ParcelBoundary=graft(parcelboundary),
    ParcelEdgeCategory=simplified_segments.ParcelEdgeCategories,
    BlockHeights=python.BlockHeights)  # -> out, simplify(ParcelSetback), simplify(OffsetCategories); inputs ParcelBoundary: tree of Curve, ParcelEdgeCategory: tree of Int32, BlockHeights: tree of Int32
# ---------- python_2: Python ----------
__author__ = "Admin"
__version__ = "2022.09.12"

import rhinoscriptsyntax as rs
import ghpythonlib.treehelpers as th
import ghpythonlib.components as gh
import Rhino
import json
import math

def GroupEdgeIndices(crv):
        count=0
        vertices=rs.PolylineVertices(crv)
        vertices.pop()
        edgeindices=[]
        for i in range(len(vertices)):
            if i==0:
                vector1=rs.VectorCreate(vertices[len(vertices)-1],vertices[0])
                vector2=rs.VectorCreate(vertices[1],vertices[0])
                
            elif i==len(vertices)-1:
                vector1=rs.VectorCreate(vertices[i-1],vertices[len(vertices)-1])
                vector2=rs.VectorCreate(vertices[0],vertices[len(vertices)-1])
                
            else: 
        
                vector1=rs.VectorCreate(vertices[i-1],vertices[i])
                vector2=rs.VectorCreate(vertices[i+1],vertices[i])
                
            angle=rs.VectorAngle(vector1,vector2)
            if rs.VectorCrossProduct(vector1,vector2).Z>0:
                angle=360-angle
    
            if angle<135 or angle>225:
                count+=1
    
            edgeindices.append(count)

            
        if edgeindices[0]==1:
            for i in range(len(edgeindices)):
                edgeindices[i]=edgeindices[i]-1
        return list(edgeindices)

def GetSimplifedSegments(segments,categories):
    
    finalSeg = []
    finalCat = []
    
    currSeg = [segments[0]]
    currCat = categories[0]
    for i,(segment,category) in enumerate(zip(segments[1:],categories[1:])):
        isLast = i == len(segments[1:])-1

        if category == currCat and isLast:
            currSeg.append(segment)
            finalSeg.append(gh.JoinCurves(currSeg,False))
            finalCat.append(category)
        
        elif category == currCat and not isLast:
            currSeg.append(segment)
            
        elif category != currCat and not isLast:
            finalSeg.append(gh.JoinCurves(currSeg,False))
            finalCat.append(currCat)
            currSeg = [segment]
            currCat = category
        
        elif category != currCat and isLast:
            finalSeg.append(gh.JoinCurves(currSeg,False))
            finalCat.append(currCat)
            finalSeg.append(segment)
            finalCat.append(category)
            

    return finalSeg, finalCat

def OffsetCategoryToDistances(edgeCategory,maxStorey):
    ans = []
    
    # SETBACK 1: Setback according to height of blocks (parametric): CommonBoundarySetback
    setbacks = [0,0,3,3.4,3.8,4.7,5.5,6.4,7.2,8,8.7,9,9.2,9.5,9.8,10.1,10.3,10.6,10.8,11.1,11.3,11.6,11.8,12.1,12.4,12.7,12.9,13.2,13.4,13.7,14,14.2,14.5,14.7,15,15.2]
    if maxStorey < 36:
        CommonBoundarySetback = setbacks[maxStorey]
    else:
        CommonBoundarySetback = 15.5
    # SETBACK 2: Setback according to type of roads (static): RoadCategorySetback
    for c in edgeCategory:
        if c == 3:
            RoadCategorySetback = 2 + 10.2 + 3 + 2 + 2.4 + 2.0
        if c == 4:
            RoadCategorySetback = 0.6 + 7 + 1.9 + 2.0 + 2.4
        if c == 5:
            RoadCategorySetback = 5 + 2.5 + 1.8
        if c == 6:
            RoadCategorySetback = 0
        
        # USE MORE STRINGENT SETBACK
        if RoadCategorySetback > CommonBoundarySetback:
            ans.append(RoadCategorySetback)
        else:
            ans.append(CommonBoundarySetback)
    return [float(a) for a in ans]

def OffsetSimplifiedSegments(simplifiedSegments,offsetDistances):
    
    orginalBoundary = gh.JoinCurves(simplifiedSegments,True)
    offsetSegment = []

    for i in range(len(simplifiedSegments)):
        offsetA = gh.OffsetCurve(simplifiedSegments[i],offsetDistances[i],gh.XYPlane(gh.ConstructPoint(0,0,0)),1)
        offsetB = gh.OffsetCurve(simplifiedSegments[i],-offsetDistances[i],gh.XYPlane(gh.ConstructPoint(0,0,0)),1)
        
        if type(offsetA) is not list:
            offsetA = [offsetA]
        if type(offsetB) is not list:
            offsetB = [offsetB]
        
        if all([gh.PointInCurve(gh.CurveMiddle(offset),orginalBoundary)[0] == 2 for offset in offsetA]):
            offsetSegment += offsetA
        else:
            offsetSegment += offsetB
    return offsetSegment

def OffsetList(lst):
  return lst[1:] + lst[:1]
  
def ReorderSegments(segment,category, indicies):
    mysegment = segment
    mycategory = category
    myindicies = indicies
    count = 0
    while True:
        count += 1
        if mycategory[0] == mycategory[-1]:
            mysegment = OffsetList(mysegment)
            mycategory = OffsetList(mycategory)
            myindicies = OffsetList(myindicies)
        else:
            break
        if count > len(category):
            break
    return mysegment,mycategory,myindicies

def OffsetPolyManyDistsInwards(polyline,distances):
    
    if gh.Area(gh.OffsetCurve(polyline,distances[0],None,1))[0] < gh.Area(gh.OffsetCurve(polyline,-distances[0],None,1))[0]:
        polyOffsetRef = gh.OffsetCurve(polyline,10,None,1)
        
    else:
        polyOffsetRef = gh.OffsetCurve(polyline,-10,None,1)
    segments, vertices = gh.Explode(polyline, True)
    segmentsRef, verticesRef = gh.Explode(polyOffsetRef, True)
    centroid = gh.Area(polyline)[1]
    offsetSegments = []
    finalVertices = []
    
    for i in range(len(distances)):
        dist = distances[i]
        offsetA = gh.OffsetCurve(segments[i],dist,None,0)
        offsetB = gh.OffsetCurve(segments[i],-dist,None,0)
        if gh.CurveClosestPoint(rs.CurveMidPoint(offsetA),polyOffsetRef)[2] < gh.CurveClosestPoint(rs.CurveMidPoint(offsetB),polyOffsetRef)[2]:
            offsetSegments.append(offsetA)
        else:
            offsetSegments.append(offsetB)
    
    for i in range(len(offsetSegments)):
        currOffset = offsetSegments[i]
        prevOffset = offsetSegments[i-1]
        pta,ptb,dist = gh.CurveProximity(currOffset,prevOffset)
        if dist < 0.5:
            finalVertices.append(pta)
        else:
            finalVertices.append(gh.LineXLine(offsetSegments[i],offsetSegments[i-1])[2])
    return gh.PolyLine(finalVertices, True)


def RebuildOffsetSegments(simplfiedOffsetSegments):
    
    finalVertices = []
    nSegments = len(simplfiedOffsetSegments)
    
    if nSegments==1:
        return simplfiedOffsetSegments[0]
    
    if nSegments == 2:
        
        currSeg = simplfiedOffsetSegments[0]
        
        nextSeg = simplfiedOffsetSegments[1]
        icd, tc, td = gh.CurveXCurve(currSeg,nextSeg)
        if len(icd)>0:
            finalVertices += gh.ControlPoints(gh.Shatter(currSeg,tc)[1])[0]
            finalVertices += gh.ControlPoints(gh.Shatter(nextSeg,td)[1])[0]
        else:
            finalVertices += gh.ControlPoints(currSeg)[0]
            finalVertices += gh.ControlPoints(currSeg)[0]
            
        
    else:
        for i in range(nSegments):
    
            prevSeg = simplfiedOffsetSegments[i-1]
            currSeg = simplfiedOffsetSegments[i]
            nextSeg = simplfiedOffsetSegments[(i+1)%nSegments]

            prevSeg = gh.ExtendCurve(gh.RebuildCurve(prevSeg,1,100,True),0,20,20)
            currSeg = gh.ExtendCurve(gh.RebuildCurve(currSeg,1,100,True),0,20,20)
            nextSeg = gh.ExtendCurve(gh.RebuildCurve(nextSeg,1,100,True),0,20,20)
            
            iab, ta, tb = gh.CurveXCurve(prevSeg,currSeg)
            icd, tc, td = gh.CurveXCurve(currSeg,nextSeg)
            
            
            if type(iab) is list:
                iab, ta, tb = iab[0], ta[0], tb[0]
            if type(icd) is list:
                icd, tc, td = icd[0], tc[0], td[0]
            
            print(iab, ta, tb)
            print(icd, tc, td)
            
            # if intersect with next segment, cut short, take first segment
            # if intersect with previous segment, cut short, take second segment
            if icd == None and iab != None:
                finalVertices += gh.ControlPoints(gh.Shatter(currSeg,tb)[1])[0]
            
            if icd and iab == None:
                finalVertices += gh.ControlPoints(gh.Shatter(currSeg,tc)[0])[0]
            
            if icd and iab:
                finalVertices += gh.ControlPoints(gh.Shatter(currSeg,[tb,tc])[1])[0]
            
            if iab and icd == None:
                finalVertices += gh.ControlPoints(gh.Shatter(currSeg,tc)[1])[0]
            
    #remove nearby points
    finalfinalVertices = []
    for i in range(len(finalVertices)):
        if gh.Distance(finalVertices[i],finalVertices[i-1]) > 0.5:
            finalfinalVertices.append(finalVertices[i])
    
    
    return gh.PolyLine(finalfinalVertices,True)

OffsetSegments = []
OffsetDistances = []
OffsetCategories = []
a = []

for path in ParcelBoundary.Paths:
    
    if path[0] <9:

        parcelBoundary = ParcelBoundary.Branch(path)[0]
        parcelSegments = gh.Explode(parcelBoundary,True)[0]
        parcelEdgeCategory = list(ParcelEdgeCategory.Branch(path))
        blockHeights = list(BlockHeights.Branch(path))
        simplifyIndexes = GroupEdgeIndices(parcelBoundary)
        parcelSegments, parcelEdgeCategory, simplifyIndexes = ReorderSegments(parcelSegments,parcelEdgeCategory, simplifyIndexes)
        
        simplifiedSegments, simplifiedCategories = GetSimplifedSegments(parcelSegments,parcelEdgeCategory)
        offsetDistances = OffsetCategoryToDistances(simplifiedCategories, max(blockHeights))
        offsetSegment = OffsetSimplifiedSegments(simplifiedSegments,offsetDistances)
        
        rebuiltClosedOffset = RebuildOffsetSegments(offsetSegment)
        
        OffsetSegments.append([rebuiltClosedOffset])
        OffsetCategories.append([parcelEdgeCategory])
        

ParcelSetback = th.list_to_tree(OffsetSegments)
OffsetCategories = th.list_to_tree(OffsetCategories)
# ---------- end python_2 ----------
siteaccess = GhPythonScript(ParcelBoundary=graft(parcelboundary), ParcelEdgeCategory=sample_parcels_2.ParcelEdgeCategory)  # -> out, simplify(SiteAccess), simplify(SiteAccessPlane); inputs ParcelBoundary: tree of Curve, ParcelEdgeCategory: tree
# ---------- siteaccess: Python ----------
__author__ = "Anna Yenardi"
__version__ = "2022.05.19"

import rhinoscriptsyntax as rs
import ghpythonlib.components as gh
import ghpythonlib.treehelpers as th
import math

def GetSegmentForAccess(boundary, categories):

    segments = gh.Explode(boundary,True)[0]
    weakestCategory = [i for i, x in enumerate(categories) if x == max(categories)]
    print(weakestCategory)
    subsetSegments = [segments[wc] for wc in weakestCategory]
    subsetLengths = [gh.Length(ss) for ss in subsetSegments]
    return weakestCategory[subsetLengths.index(max(subsetLengths))]


def GenerateSiteAccess(boundary, accessIndex, accessLength, accessWidth):
    
    segments = gh.Explode(boundary,True)[0]
    accessPt = gh.CurveMiddle(segments[accessIndex])
    
    # get inward perpendicular vector
    accessAlong = gh.Vector2Pt(gh.EndPoints(segments[accessIndex])[0],gh.EndPoints(segments[accessIndex])[1], True)[0]
    accessPerp = gh.CrossProduct(accessAlong,gh.UnitZ(1),True)[0]
    accessCenter = gh.Vector2Pt(accessPt,gh.Area(boundary)[1],True)[0]
    
    # check for directionality
    if gh.DotProduct(accessPerp,accessCenter,True) < 0:
        accessPerp *= -1
    if gh.CrossProduct(accessAlong,accessPerp,True)[0][2] < 0:
        accessAlong *= -1
    acessPlane = gh.ConstructPlane(accessPt,accessAlong,accessPerp)
    rectPlane = gh.ConstructPlane(gh.Move(accessPt,gh.Amplitude(accessAlong,-accessWidth/2))[0],accessAlong,accessPerp)
    rectGeo = gh.Rectangle(rectPlane,accessWidth,accessLength,0)[0]
    circleGeo = gh.CircleCNR(gh.Move(accessPt,gh.Amplitude(accessPerp,accessLength))[0],gh.UnitZ(1),accessWidth/2)
    accessRegion = gh.RegionUnion([rectGeo,circleGeo])
    return acessPlane,accessRegion


accessLength = 30
accessWidth = 20

SiteAccess = []
SiteAccessPlane = []
for path in ParcelBoundary.Paths:
    parcelBoundary = ParcelBoundary.Branch(path)[0]
    parcelEdgeCategories = ParcelEdgeCategory.Branch(path)
    accessIndex = GetSegmentForAccess(parcelBoundary, parcelEdgeCategories)
    sap, sa = GenerateSiteAccess(parcelBoundary, accessIndex, accessLength, accessWidth)
    SiteAccess.append([sa])
    SiteAccessPlane.append([sap])

SiteAccess = th.list_to_tree(SiteAccess)
SiteAccessPlane = th.list_to_tree(SiteAccessPlane)
# ---------- end siteaccess ----------
blockkey_collection_2 = Curve([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])
python_3 = GhPythonScript(ParcelBoundary=parcelboundary, GridRotation=num_3, GridSize=num_4)  # -> out, simplify(SortedGridLines), simplify(SortedGridPlanes); inputs ParcelBoundary: tree of Curve, GridRotation: tree, GridSize: tree
# ---------- python_3: Python ----------
__author__ = "Admin"
__version__ = "2022.09.07"

import rhinoscriptsyntax as rs
import ghpythonlib.components as gh
import ghpythonlib.treehelpers as th
import Rhino

SortedGridPlanes = []
SortedGridLines = []

for path in ParcelBoundary.Paths:
    parcelBoundary = ParcelBoundary.Branch(path)[0]
    gridRotation = GridRotation.Branch(path)[0]
    gridSize = GridSize.Branch(path)[0]

    # create grid of points within boundary
    rotatedPlane = gh.RotatePlane(gh.XYPlane(gh.ConstructPoint(0,0,0)),gridRotation)
    rotatedBox = gh.BoundingBox(parcelBoundary,rotatedPlane)
    cornerPoint = gh.BoxCorners(rotatedBox)[0]
    vecX = gh.DeconstructPlane(rotatedPlane)[1]
    vecY = gh.DeconstructPlane(rotatedPlane)[2]
    extX = int(gh.DeconstructBox(rotatedBox)[1][0].Length / gridSize)+1
    extY = int(gh.DeconstructBox(rotatedBox)[2][0].Length / gridSize)+1
    gridPoints = gh.Square(gh.ConstructPlane(cornerPoint,vecX,vecY),gridSize,extX,extY)[1]
    gridPoints = [pt for pt in gridPoints if gh.PointInCurve(pt, parcelBoundary)[0] == 2]
    
    # create grid of planes facing closest edge
    CCP = [gh.CurveClosestPoint(gp, parcelBoundary) for gp in gridPoints]
    closestDistances = [s[2] for s in CCP]
    closestPoints = [s[0] for s in CCP]
    planeY = [gh.Vector2Pt(gridPoints[i],closestPoints[i],False)[0] for i in range(len(gridPoints))]
    planeX = [gh.CrossProduct(pY,gh.UnitZ(1),True)[0] for pY in planeY]
    gridPlanes = [gh.ConstructPlane(gridPoints[i],planeX[i],planeY[i]) for i in range(len(gridPoints))]
    
    # sort grid of planes by distance to edge
    distances = [gh.VectorLength(vec) for vec in planeY]
    gridPlanes = [x for _, x in sorted(zip(distances, gridPlanes))]
    
    # append to tree
    SortedGridPlanes.append(gridPlanes)
    SortedGridLines.append([gh.LineSDL(gridPoints[i],planeY[i],distances[i]) for i in range(len(gridPoints))])

    
SortedGridPlanes = th.list_to_tree(SortedGridPlanes)
SortedGridLines = th.list_to_tree(SortedGridLines)
# ---------- end python_3 ----------
cluster_2 = Cluster_2(crv=blockkey_collection_2, X=num, Y=num_2)
python_4 = GhPythonScript(
    ParcelBoundary=graft(parcelboundary),
    SiteAccess=siteaccess.SiteAccess,
    ParcelSetback=python_2.ParcelSetback,
    SortedGridPlanes=python_3.SortedGridPlanes,
    SelectedBKey=cluster_2,
    BlockHeights=python.BlockHeights)  # -> out, simplify(OrientedBKeyFootprint), simplify(OrientationPlane), simplify(OrientedBKeyStoreys); inputs ParcelBoundary: tree of Curve, SiteAccess: tree of Curve, ParcelSetback: tree of Curve, SortedGridPlanes: tree of Plane, SelectedBKey: tree of Curve, BlockHeights: tree
# ---------- python_4: Python ----------
import rhinoscriptsyntax as rs
import ghpythonlib.treehelpers as th
import ghpythonlib.components as gh
import Rhino
import json
import math

def Remap(value,low1,high1,low2,high2):
    return low2 + (value - low1) * (high2 - low2) / (high1 - low1)

def ProcessFootPrint(object):
    box = gh.BoundingBox(object,gh.XYPlane(gh.ConstructPoint(0,0,0)))
    xdom = gh.DeconstructBox(box).x[0]
    ydom = gh.DeconstructBox(box).y[0]
    bBox = gh.PolyLine([gh.ConstructPoint(xdom[0], ydom[0], 0), gh.ConstructPoint(xdom[1], ydom[0], 0), gh.ConstructPoint(xdom[1], ydom[1], 0), gh.ConstructPoint(xdom[0], ydom[1], 0)], True)
    return [max(xdom[1]-xdom[0],ydom[1]-ydom[0]), bBox]

def GetMaxAllowedStoreys(GPR,blockLength):
    if blockLength > 130:
        maxA = 8
    elif blockLength > 90:
        maxA = 12
    elif blockLength > 75:
        maxA = 18
    elif blockLength > 60:
        maxA = 24
    else:
        maxA = 80    
    
    if GPR <= 1.4:
        maxB = 5
    elif GPR <= 1.6:
        maxB = 12
    elif GPR <= 2.1:
        maxB = 24
    elif GPR <= 2.8:
        maxB = 36
    else:
        maxB = 50
    return min(maxA, maxB)

def OffsetCategoryToDistances(edgeCategory,maxStorey):
    ans = []
    
    # SETBACK 1: Setback according to height of blocks (parametric): CommonBoundarySetback
    setbacks = [0,0,3,3.4,3.8,4.7,5.5,6.4,7.2,8,8.7,9,9.2,9.5,9.8,10.1,10.3,10.6,10.8,11.1,11.3,11.6,11.8,12.1,12.4,12.7,12.9,13.2,13.4,13.7,14,14.2,14.5,14.7,15,15.2]
    if maxStorey < 36:
        CommonBoundarySetback = setbacks[maxStorey]
    else:
        CommonBoundarySetback = 15.5
    # SETBACK 2: Setback according to type of roads (static): RoadCategorySetback
    for c in edgeCategory:
        if c == 3:
            RoadCategorySetback = 2 + 10.2 + 3 + 2 + 2.4 + 2.0
        if c == 4:
            RoadCategorySetback = 0.6 + 7 + 1.9 + 2.0 + 2.4
        if c == 5:
            RoadCategorySetback = 5 + 2.5 + 1.8
        if c == None:
            RoadCategorySetback = 0
        
        # USE MORE STRINGENT SETBACK
        if RoadCategorySetback > CommonBoundarySetback:
            ans.append(RoadCategorySetback)
        else:
            ans.append(CommonBoundarySetback)
    return ans

def OffsetPolyManyDistsInwards(polyline,distances):
    if gh.Area(gh.OffsetCurve(polyline,distances[0],None,1))[0] < gh.Area(gh.OffsetCurve(polyline,-distances[0],None,1))[0]:
        polyOffsetRef = gh.OffsetCurve(polyline,10,None,1)
    else:
        polyOffsetRef = gh.OffsetCurve(polyline,-10,None,1)
    segments, vertices = gh.Explode(polyline, True)
    segmentsRef, verticesRef = gh.Explode(polyOffsetRef, True)
    centroid = gh.Area(polyline)[1]
    offsetSegments = []
    finalVertices = []
    for i in range(len(distances)):
        dist = distances[i]
        offsetA = gh.OffsetCurve(segments[i],dist,None,0)
        offsetB = gh.OffsetCurve(segments[i],-dist,None,0)
        if gh.CurveClosestPoint(rs.CurveMidPoint(offsetA),polyOffsetRef)[2] < gh.CurveClosestPoint(rs.CurveMidPoint(offsetB),polyOffsetRef)[2]:
            offsetSegments.append(offsetA)
        else:
            offsetSegments.append(offsetB)
    
    for i in range(len(offsetSegments)):
        currOffset = offsetSegments[i]
        prevOffset = offsetSegments[i-1]
        pta,ptb,dist = gh.CurveProximity(currOffset,prevOffset)
        if dist < 0.5:
            finalVertices.append(pta)
        else:
            finalVertices.append(gh.LineXLine(offsetSegments[i],offsetSegments[i-1])[2])
    return gh.PolyLine(finalVertices, True)

def getPossibleSolutions(bkeyBound, siteBound, GPR, minStoreys):
    solutions = []
    bkeyArea = gh.Area(bkeyBound)[0]
    siteArea = gh.Area(siteBound)[0]
    
    processedFootPrint = ProcessFootPrint(bkeyBound)
    bound = processedFootPrint[1]
    targetTotalStoreys = int(math.floor(GPR * siteArea / bkeyArea))
    maxStoreys = GetMaxAllowedStoreys(GPR,processedFootPrint[0])
    maxBlockCount = int(math.floor(0.5 * siteArea * GPR / bkeyArea))
    
    for i in range(maxBlockCount,0,-1):
        highestDenominator = int(math.ceil((GPR * siteArea) / (bkeyArea * i)))
        blockStoreys = [highestDenominator]*i
        extraStoreys = (highestDenominator * i) - targetTotalStoreys

        for j in range(extraStoreys):
            blockStoreys[-1-j] -= 1
        
        if min(blockStoreys) >= minStoreys and max(blockStoreys) <= maxStoreys:
            if highestDenominator <= maxStoreys:
                solutions.append(json.dumps({'numBlocks': i, 'blockStoreys': blockStoreys}))
    
    #print('max block count: {0}, max storeys: {1}, total storeys required: {2}'.format(maxBlockCount,maxStoreys,targetTotalStoreys))
    return solutions

def GetOrientedBKey(parcelBoundary,obstacles,sortedGridPlanes,selectedBKey, targetCount):
    successfulBKey = []
    successfulOrientation = []

    for gridPlane in sortedGridPlanes:
        orientedBKey = gh.Orient(selectedBKey,gh.XYPlane(gh.ConstructPoint(0,0,0)),gridPlane)[0]
        
        boxOffset = 10
        orientedBBox = gh.BoundingBox(orientedBKey,gridPlane)[0]
        orientedBBox.X = Rhino.Geometry.Interval(orientedBBox.X[0]-boxOffset,orientedBBox.X[1]+boxOffset)
        orientedBBox.Y = Rhino.Geometry.Interval(orientedBBox.Y[0]-boxOffset,orientedBBox.Y[1]+boxOffset)

        if gh.CollisionOneXMany(orientedBBox,obstacles)['collision'] == False:
            successfulBKey.append(orientedBKey)
            successfulOrientation.append(gridPlane)
            obstacles.append(orientedBKey)
                    
        if len(successfulBKey) == targetCount:
            break

    return successfulBKey,successfulOrientation


OrientedBKeyStoreys = []
OrientedBKeyFootprint = []
OrientationPlane = []


for path in ParcelBoundary.Paths:
    
    parcelBoundary = ParcelBoundary.Branch(path)[0]
    parcelSetback = ParcelSetback.Branch(path)[0]
    siteAccess = SiteAccess.Branch(path)[0]
    sortedGridPlanes = SortedGridPlanes.Branch(path)
    selectedBKey = SelectedBKey.Branch(path)[0]
    blockHeights = BlockHeights.Branch(path)
    
    # Generate BKeys in place
    orientedBKeyFootprint,orientationPlane = GetOrientedBKey(parcelBoundary,[siteAccess,parcelSetback],sortedGridPlanes,selectedBKey,len(blockHeights))
    
    OrientedBKeyFootprint.append(orientedBKeyFootprint)
    OrientationPlane.append(orientationPlane)
    OrientedBKeyStoreys.append(blockHeights[:len(orientedBKeyFootprint)])


OrientedBKeyFootprint = th.list_to_tree(OrientedBKeyFootprint)
OrientationPlane = th.list_to_tree(OrientationPlane)
OrientedBKeyStoreys = th.list_to_tree(OrientedBKeyStoreys)
# ---------- end python_4 ----------
rdiff = RegionDifference(CurvesA=python_2.ParcelSetback, CurvesB=siteaccess.SiteAccess)
python_5 = GhPythonScript(
    ParcelID=sample_parcels_2.ParcelID,
    ParcelBoundary=parcelboundary,
    GPR=sample_parcels_2.ParcelGPR,
    OrientedBKeyFootprint=python_4.OrientedBKeyFootprint,
    BlockHeights=python_4.OrientedBKeyStoreys,
    OrientPlane=python_4.OrientationPlane,
    ObstacleCP=rdiff)  # -> out, BuildingJSON; inputs ParcelBoundary: Curve, OrientedBKeyFootprint: list of Curve, BlockHeights: list, OrientPlane: list, ObstacleCP: Curve
# ---------- python_5: Python ----------
__author__ = "Admin"
__version__ = "2022.10.12"

import rhinoscriptsyntax as rs
import ghpythonlib.components as gh
import json

def RoundPoint(pt):
    rounded = [float("{:.7f}".format(c)) for c in pt]
    return rounded

def GetParcelJSON(OrientedBKeyFootprint,BlockHeights,OrientPlane,ObstacleCP):
    ans = {}
    for i in range(len(OrientedBKeyFootprint)):
        bldg_id = str(i).rjust(4,"0")
        ans['{0}_Bldg_{1}'.format(ParcelID,bldg_id)] = {'geometry':{},'properties':{}}
        ans['{0}_Bldg_{1}'.format(ParcelID,bldg_id)]['geometry']['type'] = 'Polygon'
        ans['{0}_Bldg_{1}'.format(ParcelID,bldg_id)]['geometry']['coordinates'] = [RoundPoint(pt) for pt in gh.ControlPoints(OrientedBKeyFootprint[i])[0]]
        ans['{0}_Bldg_{1}'.format(ParcelID,bldg_id)]['properties']['storeys'] = BlockHeights[i]
        ans['{0}_Bldg_{1}'.format(ParcelID,bldg_id)]['properties']['orientation'] = {'origin': RoundPoint(OrientPlane[i].Origin),'XAxis':RoundPoint(OrientPlane[i].XAxis),'YAxis':RoundPoint(OrientPlane[i].YAxis)}
        ans['{0}_Bldg_{1}'.format(ParcelID,bldg_id)]['properties']['obstacle'] = [RoundPoint(pt) for pt in gh.ControlPoints(ObstacleCP)[0]]
    
    totalfootprint = sum([gh.Area(OrientedBKeyFootprint[i])[0] *  BlockHeights[i] for i in range(len(BlockHeights))]) / 10000
    allowedarea = GPR * gh.Area(ParcelBoundary)[0] /10000
    ans['{0}_Bldg_{1}'.format(ParcelID,bldg_id)]['properties']['GFA'] = ('%.3f' % totalfootprint,'%.3f' % allowedarea)
    
    return json.dumps(ans)

BuildingJSON = GetParcelJSON(OrientedBKeyFootprint,BlockHeights,OrientPlane,ObstacleCP)
# ---------- end python_5 ----------
srf = Surface(python_4.OrientedBKeyFootprint)
multiplication = Multiplication(A=python_4.OrientedBKeyStoreys, B="3.5")
Z = UnitZ(Factor="0.5")
srf_2 = Surface(rdiff)
Z_2 = UnitZ(Factor="1")
move = Move(Geometry=srf, Motion=Z_2)  # -> Geometry, Transform
Z_3 = UnitZ(Factor=multiplication)
srf_3 = Surface(parcelboundary)
extr = Extrude(Base=srf_3, Direction=Z)
extr_2 = Extrude(Base=srf_2, Direction=Z_2)
extr_3 = Extrude(Base=move.Geometry, Direction=Z_3)
mesh = MeshBrep(
    Brep=extr_2,
    Settings={GridMaxCount=0, GridMinCount=16, JaggedSeams=False, MaxEdgeLength=0, MinEdgeLength=0.0001, MinTolerance=0, Refine=True, RefineAngle=0, RelativeTolerance=0.65, SimplePlanes=True, Tolerance=0})  # -> flatten(Mesh)
mesh_2 = MeshBrep(
    Brep=extr_3,
    Settings={GridMaxCount=0, GridMinCount=16, JaggedSeams=False, MaxEdgeLength=0, MinEdgeLength=0.0001, MinTolerance=0, Refine=True, RefineAngle=0, RelativeTolerance=0.65, SimplePlanes=True, Tolerance=0})  # -> flatten(Mesh)
mjoin = MeshJoin(Meshes=mesh)
mjoin_2 = MeshJoin(Meshes=mesh_2)
c_script = CSharpScript(mesh=mjoin)  # -> base64Draco; inputs mesh: Mesh
# ---------- c_script: C# ----------
    var options = new Rhino.FileIO.DracoCompressionOptions();
    options.CompressionLevel = 5;
    options.IncludeTextureCoordinates = false;
    options.IncludeVertexColors = false;

    var compressed = Rhino.FileIO.DracoCompression.Compress(mesh, options);
    base64Draco = compressed.ToBase64String();
# ---------- end c_script ----------
c_script_2 = CSharpScript(mesh=mjoin_2)  # -> base64Draco; inputs mesh: Mesh; same code as c_script
merge = Merge(Data1=c_script, Data2=c_script_2)

# ---- group: RH_OUT:BuildingHeights
int = Integer(flatten(python.BlockHeights))

# ---- group: RH_OUT:ParcelObstacle
crv = Curve(flatten(rdiff))

# ---- group: RH_OUT:BuildingFootprint
crv_2 = Curve(flatten(python_4.OrientedBKeyFootprint))

# ---- group: RH_OUT:BuildingOrientation
pln = Plane(flatten(python_4.OrientationPlane))

# ---- group: RH_OUT:BuildingJSON
txt_2 = Text(flatten(python_5.BuildingJSON))

# ---- group: RH_OUT:BuildingDracoMesh
txt_3 = Text(flatten(merge))

# ==== cluster Cluster
relay = ClusterInput()
relay_2 = ClusterInput()
X = ClusterInput()
Y = ClusterInput()
pt = ConstructPoint(XCoordinate=X, YCoordinate=Y, ZCoordinate=0)
bkeynormalized = BKeyNormalized(C=relay)
item = ListItem(List=bkeynormalized, Index=relay_2, Wrap=True)
cp = ClosestPoint(Point=pt, Cloud=item)  # -> ClosestPoint, CPIndex, Distance
item_2 = ListItem(List=relay_2, Index=cp.CPIndex, Wrap=True)
item_3 = ListItem(List=relay, Index=item_2, Wrap=True)
area = Area(Geometry=item_3)  # -> Area, Centroid
neg = Negative(Value=area.Centroid)
move = Move(Geometry=item_3, Motion=neg)  # -> Geometry, Transform
selectedbkey = Curve(move.Geometry)
selectedbkey_2 = ClusterOutput(selectedbkey)

# ==== cluster Cluster_2
crv = ClusterInput()
X = ClusterInput()
Y = ClusterInput()
bkey_selector = BKeySelector(crv=crv, X=X, Y=Y)
crv_2 = Curve(bkey_selector)
area = Area(Geometry=crv_2)  # -> Area, Centroid
orient = Orient(Geometry=crv_2, Source=area.Centroid, Target=PlaneXY(0, 0, 0))  # -> Geometry, Transform
selectedbkey = Curve(orient.Geometry)
selectedbkey_2 = ClusterOutput(selectedbkey)

# ==== cluster BKeyNormalized
C = ClusterInput()
bbox = BoundingBox(Content=C, Plane=PlaneXY(0, 0, 0))  # -> Box, Box_2
boxprop = BoxProperties(Box=bbox.Box)  # -> Center, Diagonal, Area, Volume, Degeneracy
devec = DeconstructVector(Vector=boxprop.Diagonal)  # -> XComponent, YComponent, ZComponent
bnd = Bounds(Numbers=devec.XComponent)
bnd_2 = Bounds(Numbers=devec.YComponent)
remap = RemapNumbers(Value=devec.XComponent, Source=bnd, Target=Domain(0, 1))  # -> Mapped, Clipped
remap_2 = RemapNumbers(Value=devec.YComponent, Source=bnd_2, Target=Domain(0, 1))  # -> Mapped, Clipped
pt = ConstructPoint(XCoordinate=remap.Mapped, YCoordinate=remap_2.Mapped, ZCoordinate=0)
pt_2 = ClusterOutput(pt)

# ==== cluster BKeySelector
crv = ClusterInput()
crv_2 = Curve(crv)
bbox = BoundingBox(Content=crv_2, Plane=PlaneXY(0, 0, 0))  # -> Box, Box_2
boxprop = BoxProperties(Box=bbox.Box)  # -> Center, Diagonal, Area, Volume, Degeneracy
devec = DeconstructVector(Vector=boxprop.Diagonal)  # -> XComponent, YComponent, ZComponent
num = Number(devec.XComponent)
num_2 = Number(devec.YComponent)
bnd = Bounds(Numbers=num)
bnd_2 = Bounds(Numbers=num_2)
X = ClusterInput()
Y = ClusterInput()
remap = RemapNumbers(Value=num, Source=bnd, Target=Domain(0, 1))  # -> Mapped, Clipped
remap_2 = RemapNumbers(Value=num_2, Source=bnd_2, Target=Domain(0, 1))  # -> Mapped, Clipped
pt = ConstructPoint(XCoordinate=remap.Mapped, YCoordinate=remap_2.Mapped, ZCoordinate=0)
pt_2 = ConstructPoint(XCoordinate=X, YCoordinate=Y, ZCoordinate=0)
cp = ClosestPoint(Point=pt_2, Cloud=pt)  # -> ClosestPoint, CPIndex, Distance
item = ListItem(List=crv_2, Index=cp.CPIndex, Wrap=True)
i = ClusterOutput(item)
